# Grasshopper definition BirdFlocking_GH_v02_ts.gh (Grasshopper 1.0.7)

# ---- group: new
brep = Brep([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])
brep_2 = Brep(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)
brep_3 = Brep(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)
merge = Merge(Data1=brep, Data2=brep_2)

# ----
path = FilePath("F:\Computerbasiertes Entwerfen II\2 Assignments\W11 Final\BirdFlocking\BirdFlocking.py")

opacity = WindowOpacity(A=Slider(1, range=0..1))

pt = Point(Point(446.0288227, 127.8417792, 120.2952428))
file = ReadFile(File=path, PerLineParse=False)
panel = Panel("""40
20""")
panel_2 = Panel("""3
2""")
panel_3 = Panel(""".9
.9""")
# NEEDS TO BE RENAMED
# decide for test or not
tag = TextTag(Location=pt, Text="Maultaschen")
crv = Curve([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])
timer = Timer(TimerInterval=20, Target=python)
python = GhPythonScript(
    Code=file,
    IReset=Button(),
    IEnabled=Toggle(False),
    IAgentCount=Slider(40, range=0..1100),
    IAgentVelocity=".03",
    ISpeed=Slider(2, range=0..2),
    IFoodSource=pt,
    ISeparationStrength=Slider(35.99, range=0..70),
    ISeparationDistance=Slider(18.95, range=0..50),
    IDetectonDistance=Slider(21.96, range=0..100),
    IWindSpeed=Slider(10, range=0..10),
    ICollideStrength=Slider(20, range=0..20),
    IObstacleBreps=merge,
    IBoundingBox=brep_3,
    IUpliftStrength=panel_2,
    IUpliftCrvs=crv,
    IUpliftRadius=panel,
    IUpliftRevolveStrength=panel_3,
    IPredatorCount=Slider(4, range=0..10),
    IPredatorVelocity=".1",
    IPredatorRadius=Slider(48, range=0..100),
    IPredatorSpeed=Slider(1.2, range=1..10))  # -> Out, OWind, OBirdHistory, OBirdPositions, OBirdTag, OPredatorHistory, OPredatorPositions, OPredatorTag
sph = Sphere(Base=python.OPredatorPositions, Radius=2)
panel_4 = Panel(python.Out)
tag_2 = TextTag(Location=python.OPredatorPositions, Text=python.OPredatorTag, Colour="orange")
tag_3 = TextTag(Location=python.OBirdPositions, Text=python.OBirdTag, Colour="255, 65, 77")
preview = CustomPreview(Geometry=sph, Material="255, 65, 77")
preview_2 = CustomPreview(Geometry=python.OPredatorHistory, Material="255, 65, 77")
preview_3 = CustomPreview(Geometry=python.OBirdHistory, Material="0, 111, 140")
preview_4 = CustomPreview(Geometry=python.OBirdPositions, Material="0, 111, 140")

# ==== cluster WindowOpacity
A = ClusterInput()
c_script = CSharpScript(A=A)  # -> out, e; inputs A: Double
# ---------- c_script: C# ----------
    System.Windows.Forms.Form form = Instances.DocumentEditor;


    A = Math.Min(A, 1.0);
    A = Math.Max(A, 0.1);

    form.Opacity = A;
# ---------- end c_script ----------
